# Grasshopper definition alg.gh (Grasshopper 1.0.7)

brep = Brep(<brep referenced from the Rhino model>)
volume = Volume(Geometry=brep)  # -> Volume, Centroid
debrep = DeconstructBrep(Brep=brep)  # -> Faces, Edges, Vertices
pt = Point(volume.Centroid)
dist = Distance(PointA=debrep.Vertices, PointB=pt)
avr = Average(Input=dist)
sph = Sphere(Base=PlaneXY(0, 0, 0), Radius=avr)
sdiff = SolidDifference(BrepsA=brep, BrepsB=sph)
volume_2 = Volume(Geometry=sdiff)  # -> Volume, Centroid
division = Division(A=volume_2.Volume, B=volume.Volume)  # -> flatten(Result)
ma = MassAddition(Input=division)  # -> Result, PartialResults
panel = Panel(ma.Result)
